# Grasshopper definition FoodChainOverview.gh (Grasshopper 1.0.7)
# plug-ins: FoodChain

graph_parser = GraphParser(Uri="http://www.w3id.org/bot/bot.ttl")  # -> Graph, Txt
panel = Panel(graph_parser.Graph)
panel_2 = Panel(graph_parser.Txt)
